# Dynamo graph BasicConnection.dyn (Dynamo 1.3.0.875)

code_block = CodeBlock { 2; }
byCoordinates = Point.ByCoordinates(z=code_block)
YAxis = Vector.YAxis()
ZAxis = Vector.ZAxis()

# group: Member Parameters
rotate = DoubleSlider(-2.7, range=-180..180 step 0.1)
member_length = DoubleSlider(26.4, range=0..100 step 0.1)

rotate_2 = Vector.Rotate(YAxis, ZAxis, rotate)
XAxis = Vector.XAxis()
create = List.Create(rotate_2, XAxis)
byStartPointDirectionLength = Line.ByStartPointDirectionLength(startPoint=byCoordinates, direction=create, length=member_length)

# group: Connection Parameters
three_piece_brace = BoolSelector(false)
brace_length_1 = DoubleSlider(11.8, range=0..100 step 0.1)
brace_length_2 = DoubleSlider(8.1, range=0..100 step 0.1)
first_connection_is_face_to_face = BoolSelector(false)

structureOptions = HowickMaker.hStructure.StructureOptions(arg2=three_piece_brace, arg3=brace_length_1, arg4=brace_length_2, arg5=first_connection_is_face_to_face)
fromLines = HowickMaker.hStructure.FromLines(byStartPointDirectionLength, structureOptions)
length = HowickMaker.hMember.Length(fromLines.out1)
