# Dynamo graph CreateMember.dyn (Dynamo 1.3.0.875)

code_block = CodeBlock { 2; }
byCoordinates = Point.ByCoordinates(z=code_block)
XAxis = Vector.XAxis()

# group: Member Parameters
member_length = DoubleSlider(38.3, range=0..100 step 0.1)
member_rotation = DoubleSlider(0, range=0..100 step 0.1)

byStartPointDirectionLength = Line.ByStartPointDirectionLength(startPoint=byCoordinates, direction=XAxis, length=member_length)
ZAxis = Vector.ZAxis()
rotate = Vector.Rotate(ZAxis, XAxis, member_rotation)
byLineVector = HowickMaker.hMember.ByLineVector(byStartPointDirectionLength, rotate)

# group: Operation Locations
WEB = DoubleSlider(0.54, range=0..1 step 0.01)
SERVICE_HOLE = DoubleSlider(0.24, range=0..1 step 0.01)
BOLT = DoubleSlider(0.5, range=0..1 step 0.01)
NOTCH = DoubleSlider(0.31, range=0..1 step 0.01)
SWAGE = DoubleSlider(0.22, range=0..1 step 0.01)
END_TRUSS = DoubleSlider(0, range=0..1 step 0.01)
LIP_CUT = DoubleSlider(0.8, range=0..1 step 0.01)
DIMPLE = DoubleSlider(0.43, range=0..1 step 0.01)

create = List.Create(WEB, SERVICE_HOLE, BOLT, NOTCH, SWAGE, END_TRUSS, LIP_CUT, DIMPLE)
mul = create * member_length
code_block_2 = CodeBlock { "WEB"; "SERVICE_HOLE"; "BOLT"; "NOTCH"; "SWAGE"; "END_TRUSS"; "LIP_CUT"; "DIMPLE"; }
create_2 = List.Create(code_block_2.out0, code_block_2.out1, code_block_2.out2, code_block_2.out3, code_block_2.out4, code_block_2.out5, code_block_2.out6, code_block_2.out7)
addOperationByLocationType = HowickMaker.hMember.AddOperationByLocationType(byLineVector, mul, create_2)
asCSVLine = HowickMaker.hMember.AsCSVLine(addOperationByLocationType)
watch = Watch(asCSVLine)
