# Dynamo graph FromDWG.dyn (Dynamo 1.3.0.875)

file_path = Filename("No file selected.")
fromPath = Dynamo.Translation.FileLoader.FromPath(file_path)
getImportedObjects = Dynamo.Translation.FileLoader.GetImportedObjects(fromPath)
convertToGeometries = Dynamo.Translation.ImportedObject.ConvertToGeometries(getImportedObjects)
code_block = CodeBlock { 12; }
boolean = BoolSelector(false)
structureOptions = HowickMaker.hStructure.StructureOptions(arg3=code_block, arg5=boolean)
fromLines = HowickMaker.hStructure.FromLines(convertToGeometries, structureOptions)
code_block_2 = CodeBlock { "Use the FilePath node to load test.dwg from the examples folder"; }
