# Dynamo graph TConnection.dyn (Dynamo 1.3.0.875)

joint_location = DoubleSlider(3, range=0..3 step 0.1)
code_block = CodeBlock { 2; 10; }
byCoordinates = Point.ByCoordinates(x=joint_location, z=code_block.out0)
code_block_2 = CodeBlock { 2; }
byCoordinates_2 = Point.ByCoordinates(z=code_block_2)
create = List.Create(byCoordinates, byCoordinates_2)
YAxis = Vector.YAxis()
ZAxis = Vector.ZAxis()

# group: Member Parameters
rotate = DoubleSlider(13.7, range=-180..180 step 0.1)
member_length = DoubleSlider(27.3, range=0..100 step 0.1)

rotate_2 = Vector.Rotate(YAxis, ZAxis, rotate)
XAxis = Vector.XAxis()
create_2 = List.Create(rotate_2, XAxis)
byStartPointDirectionLength = Line.ByStartPointDirectionLength(startPoint=create, direction=create_2, length=member_length)
code_block_3 = CodeBlock { 0.001; }
boolean = BoolSelector(false)
boolean_2 = BoolSelector(false)
fromLines = HowickMaker.hStructure.FromLines(byStartPointDirectionLength, code_block_3, boolean, boolean_2)
